# Grasshopper definition meshReducer.ghx (Grasshopper 1.0.7)

face_reduction = Slider(0.2, range=0..1)
reduction_accuracy = Slider(7, range=1..10)
distort_faces = BooleanToggle(True)
normalize_faces = BooleanToggle(True)
rebuild_normals = BooleanToggle(False)
cull_unused = BooleanToggle(True)
unify_normals = BooleanToggle(True)
flip_normals = BooleanToggle(False)
combine_identical = BooleanToggle(True)
input_breps = Brep([<brep referenced from the Rhino model> x951])

cluster = Cluster(
    R_3=rebuild_normals,
    B_2=face_reduction,
    A=reduction_accuracy,
    C=cull_unused,
    U=unify_normals,
    B=input_breps,
    D=distort_faces,
    F=flip_normals,
    N=normalize_faces,
    I=combine_identical)  # -> R, R_6, R_4, R_2, R_5

# ---- group: output mesh
mesh = Mesh(cluster.R_5)

# ----
final_vert_count = Panel(cluster.R_6)
base_vert_count = Panel(cluster.R)
triangulated_vert_count = Panel(cluster.R_2)
reduced_vert_count = Panel(cluster.R_4)

panel = Panel(mesh)

# ==== cluster Cluster
B = ClusterInput()
mesh = MeshBrep(
    Brep=B,
    Settings={GridMaxCount=0, GridMinCount=16, JaggedSeams=False, MaxEdgeLength=0, MinEdgeLength=0.0001, MinTolerance=0, Refine=True, RefineAngle=0, RelativeTolerance=0.65, SimplePlanes=True, Tolerance=0})
mshstats = MeshStatistics(Mesh=mesh)  # -> VertexCount, FaceCount, QuadFaceCount, TriangleFaceCount, ColorCount, PieceCount
tri = Triangulate(Mesh=mesh)  # -> Mesh, Count
ma = MassAddition(Input=mshstats.VertexCount)  # -> Result, PartialResults
mshstats_2 = MeshStatistics(Mesh=tri.Mesh)  # -> VertexCount, FaceCount, QuadFaceCount, TriangleFaceCount, ColorCount, PieceCount
R = ClusterOutput(ma.Result)
B_2 = ClusterInput()
ma_2 = MassAddition(Input=mshstats_2.VertexCount)  # -> Result, PartialResults
multiplication = Multiplication(A=mshstats_2.FaceCount, B=B_2)
R_2 = ClusterOutput(ma_2.Result)
A = ClusterInput()
D = ClusterInput()
N = ClusterInput()
redumsh = ReduceMesh(Mesh=tri.Mesh, FaceCount=multiplication, Accuracy=A, FaceType=0, Distort=D, Normalize=N)  # -> Reduced, CountDifference
mshstats_3 = MeshStatistics(Mesh=redumsh.Reduced)  # -> VertexCount, FaceCount, QuadFaceCount, TriangleFaceCount, ColorCount, PieceCount
ma_3 = MassAddition(Input=mshstats_3.VertexCount)  # -> Result, PartialResults
R_3 = ClusterInput()
C = ClusterInput()
U = ClusterInput()
F = ClusterInput()
I = ClusterInput()
R_4 = ClusterOutput(ma_3.Result)
rebmsh = RebuildMesh(
    Mesh=redumsh.Reduced,
    RebuildNormals=R_3,
    CullUnused=C,
    UnifyNormals=U,
    FlipNormals=F,
    IdenticalCombine=I,
    WeldVertices=0)
R_5 = ClusterOutput(rebmsh)
mshstats_4 = MeshStatistics(Mesh=rebmsh)  # -> VertexCount, FaceCount, QuadFaceCount, TriangleFaceCount, ColorCount, PieceCount
ma_4 = MassAddition(Input=mshstats_4.VertexCount)  # -> Result, PartialResults
R_6 = ClusterOutput(ma_4.Result)
